# Grasshopper definition LatLon.ghx (Grasshopper 1.0.7)
# plug-ins: ElkGHComponents

file_path = FilePath("Z:\Sites\Caribou\Caribou.Tests\Cases\melbourne.xml")
location = Location(FilePathText=file_path)  # -> OSMPointData, OSMFile, LongitudeDomain, LatitudeDomain
osm_data = OSMData(
    OSMPointData=location.OSMPointData,
    OSMFilePath=file_path,
    Feature="amenity",
    Generate3d=False,
    IndividualOutputs=False,
    SelectedTypes="arts_centre")  # -> Ways, FeatureKey
panel = Panel(osm_data.Ways)
panel_2 = Panel(osm_data.FeatureKey)
