# Grasshopper definition Melbourne.ghx (Grasshopper 1.0.7)
# plug-ins: Caribou

path = FilePath("Z:\Sites\Caribou\Caribou.Tests\Cases\melbourne.osm.xml")
file = ReadFile(File=path, PerLineParse=False)
file_2 = ReadFile(File=path, PerLineParse=True)  # disabled
osm = OpenStreetMap(OSMContent=file)  # -> Nodes, Ways, Debug
osm_2 = OpenStreetMap(OSMContent=file_2)  # -> Ways, Nodes, Debug; disabled
panel = Panel(osm.Debug)
panel_2 = Panel(osm.Nodes)
panel_3 = Panel(osm.Ways)
