# Grasshopper definition Simple.ghx (Grasshopper 1.0.7)
# plug-ins: Caribou, LunchBox

# ---- group: Simple XML File
path = FilePath("Z:\Sites\Caribou\Caribou.Tests\Cases\simple.xml")

# ---- group: Melbourne XML File
path_2 = FilePath("Z:\Sites\Caribou\Caribou.Tests\Cases\melbourne.xml")

# ---- group: Multiple XML Files
path_3 = FilePath(["Z:\Sites\Caribou\Caribou.Tests\Cases\multipleA.xml", "Z:\Sites\Caribou\Caribou.Tests\Cases\multipleB.xml", "Z:\Sites\Caribou\Caribou.Tests\Cases\multipleC.xml"])

# ----
panel = Panel("tests")
panel_2 = Panel("""highway=
traffic_signals""")
panel_3 = Panel("cuisine=mexican")
panel_4 = Panel("waterway=")
panel_5 = Panel("amenity=*")
panel_6 = Panel("craft")
panel_7 = Panel("building")
read_file = ReadFile(File=path_2, PerLineParse=False)
text = Text("addr:street=Swanston Street")
openstreetmap = OpenStreetMap(OSMContent=read_file, OSMFeatures=text)  # -> Ways, Tags, Features, Debug
openstreetmap_2 = OpenStreetMap(OSMContent=read_file, OSMFeatures=text)  # -> Nodes, Tags, Report, Debug
panel_8 = Panel(openstreetmap_2.Nodes)
panel_9 = Panel(openstreetmap_2.Report)
panel_10 = Panel(openstreetmap.Ways)
panel_11 = Panel(openstreetmap.Features)
panel_12 = Panel(openstreetmap_2.Tags)
panel_13 = Panel(openstreetmap.Tags)
color_per_branch = ColorPerBranch(geometry=openstreetmap_2.Nodes)  # -> geometry_4, colour_2
list_item = ListItem(List=openstreetmap_2.Report, Index="0", Wrap=True)  # -> flatten(Item)
list_item_2 = ListItem(List=openstreetmap.Features, Index="1", Wrap=True)  # -> flatten(Item)
panel_14 = Panel("Vis in Grasshopper")
color_per_branch_2 = ColorPerBranch(geometry=openstreetmap_2.Nodes)  # -> geometry_4, colour_2
text_2 = Text(list_item)
legend = Legend(Colour=color_per_branch_2.colour_2, Tags=text_2, LegendType=1)
custom_preview = CustomPreview(Geometry=color_per_branch_2.geometry_4, Material=color_per_branch_2.colour_2)
object_bake = ObjectBake(
    BakeToggle=Button(),
    GeometryObjects=color_per_branch.geometry_4,
    Layer=list_item_2,
    ObjectName="GH_Obj",
    ObjectColor=RGB(255, 255, 255),
    LayerColor=color_per_branch.colour_2)

# ==== cluster ColorPerBranch
geometry = ClusterInput()
geometry_2 = Geometry(geometry)
group = Group(Objects=geometry_2)  # -> flatten(Group)
list_length = ListLength(List=group)
panel = Panel(group)
series = Series(Start=0, Step=1, Count=list_length)
gradient = Gradient(
    LowerLimit=0,
    UpperLimit=list_length,
    Parameter=series,
    stops=[0: RGB(243, 57, 0), 0.1: RGB(236, 27, 60), 0.2: RGB(210, 0, 118), 0.3: RGB(103, 0, 120), 0.4: RGB(39, 72, 161), 0.5: RGB(1, 192, 229), 0.6: RGB(18, 178, 90), 0.7: RGB(79, 186, 8), 0.8: RGB(220, 237, 32), 0.9: RGB(247, 159, 20), 1: RGB(243, 57, 0)])
geometry_3 = Geometry(geometry_2)
colour = Colour(gradient)
geometry_4 = ClusterOutput(geometry_3)
colour_2 = ClusterOutput(colour)
